# Grasshopper definition example.gh (Grasshopper 0.9.76)
# plug-ins: Karamba, Python Interpreter, LunchBox

# ----
# geometria
eixo_x = Slider(50, range=10..60)
eixo_y = Slider(50, range=10..60)

altura = Slider(5, range=0.3..8)
divisão_u = Slider(3, range=0..10)
divisão_v = Slider(6, range=0..10)

# ----
# geometria
pt = ConstructPoint(XCoordinate=0, YCoordinate=0, ZCoordinate=0)
pt_2 = ConstructPoint(XCoordinate=eixo_x, YCoordinate=0, ZCoordinate=0)
pt_3 = ConstructPoint(XCoordinate=eixo_x, YCoordinate=eixo_y, ZCoordinate=0)
pt_4 = ConstructPoint(XCoordinate=0, YCoordinate=eixo_y, ZCoordinate=0)
ln = Line(StartPoint=pt_4, EndPoint=pt_3)
ln_2 = Line(StartPoint=pt, EndPoint=pt_2)
loft = Loft(Curves=[ln_2, ln], Options={Adjust=False, Closed=False, LoftEnds=0, LoftSimp=0, LoftType=0, Rebuild=10, Refit=0.01})
Z = UnitZ(Factor=altura)
move = Move(Geometry=loft, Motion=Z)  # -> Geometry, Transform
treliça = SpaceTrussStructure2(SurfaceA=loft, SurfaceB=move.Geometry, UDivisions=divisão_u, VDivisions=divisão_v)  # -> LinesA, LinesB, Web, Nodes
apoios = Merge(Data1=pt, Data2=pt_2, Data3=pt_3, Data4=pt_4)

# ----
# cotas
aligndim = AlignedDimension(Plane=PlaneXY(0, 0, 0), PointA=pt, PointB=pt_2, Offset=-2, Text="{0:0.00}", Size=1)
aligndim_2 = AlignedDimension(Plane=PlaneXY(0, 0, 0), PointA=pt_2, PointB=pt_3, Offset=-2, Text="{0:0.00}", Size=1)

index = Slider(10, range=0..29)
index_2 = Slider(11, range=0..29)
index_3 = Slider(15, range=0..29)
# 3 perfis
# perfis 0
barras_u = Line(treliça.LinesA)
# perfis 2
barras_d = Line(treliça.Web)
# perfis 1
barras_b = Line(treliça.LinesB)
nós = Point(treliça.Nodes)

# ---- group: caminho tabela_perfis.csv
path = FilePath("C:\Users\Renato\OneDrive\github\automated_structural_analysis_of_steel_truss\tabela_perfil.csv")

# ----
merge = Merge(Data1=index, Data2=index_2, Data3=index_3)

# ----
# Simplification: here we are considering a load equally distributed by all support nodes.
peso_próprio_da_telha_por_m2_kg = Panel("9.0")
# carga
disc = Discontinuity(Curve=barras_b, Level=1)  # -> flatten(Points), Parameters
sobrecarga_por_m2_kg = Panel("30.0")
rdpoints = RemoveDuplicatePointsKaramba(Point=disc.Points, LimitDistance=0.005)  # -> OutPoint, Info, Indexes
# pontos
pt_5 = Point(flatten(rdpoints.OutPoint))
item = ListItem(List=pt_5, Index=[0, -1], Wrap=True)
# cálculo
python = PythonScript(x=item, y=pt_5, overLoad=sobrecarga_por_m2_kg, ownWeight=peso_próprio_da_telha_por_m2_kg)  # -> out, loadPoint; inputs x: list of Point3d, y: list
# ---------- python: Python ----------
import rhinoscriptsyntax as rs
import Rhino.Geometry as rg

a = x 
b = a[0]
c = a[1]


roofing = rs.AddRectangle(rg.Plane.WorldXY, b, c)
area = rs.Area(roofing)
print ('área cobertura: %.2f m²' % area)

loadTotal = (((area * overLoad) + (area * ownWeight))*(- 0.0098))
p = y
pointsNumber =  (len(p))

loadPoint = loadTotal / pointsNumber 
print ('valor carga por nó: %.2f N' %loadPoint)
# ---------- end python ----------
info = Panel(python.out)

# ----
# seleção de
#     perfils
python_2 = PythonScript(f=path, index=merge)  # -> out, graft(lista_perfil); inputs index: list of Int32
# ---------- python_2: Python ----------
"""
BLOCO_A
    INPUTS:
        f     --> Item access --> type: ghdoc (rhinoscriptsyntax)
        index --> um (01) perfil   : Item access --> type: int
                  dois ou n perfis : List access --> type: int
    OUTPUTS:
        out  --> informações visuais (perfi(s), diâmetro(s) e espessura(s))
        lista_perfil --> lista de diâmetro(s) e espessura(s) dos perfis
"""

import rhinoscriptsyntax as rs

lista = []               
f = open(f, 'r')         

for line in f:
    lista_line = line.rstrip().split('\t')
    lista.append(lista_line)

tamanho_index = len(index)
lista_perfil = []
cont = 0

while cont < tamanho_index:      
    i = index[cont]
    profile = lista[i]
    p = profile[0].split(',')  
    diameter = p[0] 
    Diameter = float(diameter) / 10
    lista_perfil.append(Diameter)
    thickness = p[1]
    Thickness = float(thickness) / 10
    lista_perfil.append(Thickness)
    cont += 1


a = (lista_perfil)

cont_2 = 0
cont_3 = 1
size_lista_perfil = len(a)
for i in range(tamanho_index):
    print ("perfil %s -(d) %.2f cm -(t) %.2f cm" %(i, a[cont_2], a[cont_3]))
    cont_2 += 2
    cont_3 += 2
# ---------- end python_2 ----------
info_2 = Panel(python_2.out)

# ---- group: first and last number
panel = Panel(item)

# ----
bang = ExplodeTree(Data=python_2.lista_perfil)  # -> Branch0, Branch1, Branch2, Branch3, Branch4, Branch5
panel_2 = Panel([bang.Branch0, bang.Branch1, bang.Branch2, bang.Branch3, bang.Branch4, bang.Branch5])
diamêtros = Merge(Data1=bang.Branch0, Data2=bang.Branch2, Data3=bang.Branch4)  # -> flatten(Result)
espessuras = Merge(Data1=bang.Branch1, Data2=bang.Branch3, Data3=bang.Branch5)  # -> flatten(Result)

# ---- group: Resistance (KN/mm²)
panel_3 = Panel("0.25")

# ----
entwine = Entwine(Branch00=barras_u, Branch01=barras_b, Branch02=barras_d, FlattenInputs=True)
# resistência
#    máxima
python_3 = PythonScript(diameterCm=diamêtros, thicknessCm=espessuras, materialResistance=panel_3)  # -> out, maximumResistance; inputs diameterCm: list, thicknessCm: list
# ---------- python_3: Python ----------
"""
BLOCO_B
    INPUTS:
        diameterCm -->  um (01) perfil   : Item access --> type: float
                        dois ou n perfis : List access --> type: float
        thicknessCm --> um (01) perfil   : Item access --> type: float
                        dois ou n perfis : List access --> type: float
        materialResistance --> Item access --> type: float
    OUTPUTS:
        out  --> informações visuais (resistência(s) máxima(s))
        maximumResistance --> lista de resistência(s) máxima(s)
"""

listDiameter = (diameterCm)
listThickness = (thicknessCm)

num = (len(listThickness))
cont = 0

maximumResistance = []

while cont < num:
    diameter = listDiameter[cont] * 10
    thickness = listThickness[cont] * 10
    profileArea = (((3.14159 * diameter ** 2)/4) 
                - ((3.14159 * (diameter-(thickness*2)) **2 )/4))
    maxRes = profileArea * materialResistance
    maximumResistance.append(maxRes)
    cont += 1

size_maximumResistance = len(maximumResistance)
cont_2 = 0
for i in range(size_maximumResistance):
    valor = maximumResistance[cont_2]
    print("Res. Máxima perfil %s = %.2f KN." %(i, valor))
    cont_2 += 1
# ---------- end python_3 ----------
info_3 = Panel(python_3.out)
panel_4 = Panel("""U
B
D""")
Z_2 = UnitZ(Factor=python.loadPoint)
panel_5 = Panel("D")
panel_6 = Panel("U")
panel_7 = Panel("B")
panel_8 = Panel(python_3.maximumResistance)
panel_9 = Panel("""U
B
D""")

# ----
# definições do modelo
linetobeam = LineToBeamKaramba(Line=entwine, New=True, Remove=True, LimitDistance_m=0.005, BeamIdentifier=graft(panel_4))  # -> Points, flatten(Element), Info
# seções
cross_sections = CrossSectionsKaramba(ElementsIdentifiers=panel_6, Diameter_cm=bang.Branch0, WallThickness_cm=bang.Branch1, mode="Circular Hollow")
cross_sections_2 = CrossSectionsKaramba(ElementsIdentifiers=panel_7, Diameter_cm=bang.Branch2, WallThickness_cm=bang.Branch3, mode="Circular Hollow")
cross_sections_3 = CrossSectionsKaramba(ElementsIdentifiers=panel_5, Diameter_cm=bang.Branch4, WallThickness_cm=bang.Branch5, mode="Circular Hollow")
loads = LoadsKaramba(ForceVector=Z_2, Local=False, PosInd=pt_5, LCase=0, mode="Point")
# apoio
supp = SupportKaramba(PosInd=apoios, menu=[buttons(on, on, on, on, on, on)])
# cargas
loads_2 = LoadsKaramba(Vector=Vector(0, 0, -1), LCase=0, mode="Gravity")
# material
matselect = MaterialSelectionKaramba(ElementsIdentifiers=panel_9, menu=[dropdown(1), dropdown(4)])

profiles = Merge(Data1=cross_sections, Data2=cross_sections_2, Data3=cross_sections_3)
list_max_resistencias = Number(python_3.maximumResistance)
# números
# de barras
lng = ListLength(List=barras_u)
lng_2 = ListLength(List=barras_b)
lng_3 = ListLength(List=barras_d)
panel_10 = Panel("""255
255
255
175
0
0
0""")
merge_2 = Merge(Data1=lng, Data2=lng_2, Data3=lng_3)  # -> flatten(Result)
panel_11 = Panel("""0
0
255
255
255
0
0""")
rgb = ColourRGB(Alpha=255, Red=panel_10, Green=panel_11, Blue=reverse(0))

# ----
# resultados
material = MaterialKaramba(flatten(matselect))
# modelo estrutural
element = ElementKaramba(flatten(linetobeam.Element))
load = LoadKaramba(flatten([loads_2, loads]))
support = SupportKaramba(flatten(supp))
crosec = CrossSectionKaramba(flatten(profiles))
# montar
assemble = AssembleModelKaramba(Elem=element, Support=support, Load=load, CrossSection=crosec, Material=material, LimitDistance_m=0.005)  # -> Model, Info, Mass_kg, CenterOfGravity
# calcular
analyzethi = AnalyzeThIKaramba(Model=assemble.Model)  # -> CalculatedModel, MaximumDisplacement_m, ResultingForceOfGravity_kN, ElasticEnergy_kNm
max_displacement_m = Panel(analyzethi.MaximumDisplacement_m)
modelview = ModelViewKaramba(
    Model=analyzethi.CalculatedModel,
    LoadCaseFactorsForLinearSuperposition=1,
    IndexIncrementOfVisibleLoadcase=0,
    ListOfColorsForColoringPlots=rgb)  # -> Model, DeformedMesh, DeformedAxes, DeformedModel
panel_12 = Panel("U")
panel_13 = Panel("B")
panel_14 = Panel("D")
beamview = BeamViewKaramba(Model=modelview.Model)  # -> Model, MeshesOfRenderedBeams, DeformedBeamAxes, LegendColors, LegendTags
# forças
# resultantes
b_res_force = BeamResultantForcesKaramba(
    AnalyzedModel=analyzethi.CalculatedModel,
    BeamIdentifiers=panel_12,
    LoadCase=-1,
    MaximumProbingDistance_m=-1,
    NumberOfProbingPointsPerElement=3)  # -> AnalyzedModel, NormalForce_kN, ResultantBendingMoment_kNm, ResultantShearForce_kN
b_res_force_2 = BeamResultantForcesKaramba(
    AnalyzedModel=analyzethi.CalculatedModel,
    BeamIdentifiers=panel_13,
    LoadCase=-1,
    MaximumProbingDistance_m=-1,
    NumberOfProbingPointsPerElement=3)  # -> AnalyzedModel, NormalForce_kN, ResultantBendingMoment_kNm, ResultantShearForce_kN
b_res_force_3 = BeamResultantForcesKaramba(
    AnalyzedModel=analyzethi.CalculatedModel,
    BeamIdentifiers=panel_14,
    LoadCase=-1,
    MaximumProbingDistance_m=-1,
    NumberOfProbingPointsPerElement=3)  # -> AnalyzedModel, NormalForce_kN, ResultantBendingMoment_kNm, ResultantShearForce_kN

model_mass_kg = Panel(assemble.Mass_kg)
# lista de forças
#    resultantes
merge_3 = Merge(Data1=b_res_force.NormalForce_kN, Data2=b_res_force_2.NormalForce_kN, Data3=b_res_force_3.NormalForce_kN)  # -> flatten(Result)
info_4 = Panel(merge_2)
info_5 = Panel(merge_3)
# análise
# estrutural
python_4 = PythonScript(x=merge_3, y=merge_2, z=list_max_resistencias)  # -> out, a; inputs x: list, y: list, z: list
# ---------- python_4: Python ----------
"""
BLOCO_C
    INPUTS:
        x -->  List access --> type: ghdoc (rhinoscriptsyntax)
        y --> um (01) perfil   : Item access --> type: int
              dois ou n perfis : List access --> type: int
        z --> um (01) perfil   : Item access --> type: float
              dois ou n perfis : List access --> type: float
    OUTPUTS:
        out  --> informações visuais (OK ou não OK)
        a --> none
"""

lista_grande = x 
sub_lista = y    

size_lista_grande = len(lista_grande)
size_sub_lista = len(sub_lista)

nova_lista = []

for i in range (size_sub_lista):
    nova_lista.append([])

n = int(sub_lista[0])
cont = 0
cont_big_list = 0
cont_sub = 0
while (cont < 3):
    size_atual = y[cont_sub]
    cont_sub += 1
    
    for j in range(int(size_atual)):
        value = x[cont_big_list]
        nova_lista[cont].append(value)
        cont_big_list += 1
    cont += 1

a = nova_lista[2]
#print a

solMax = []                                             
cont_three = 0

while (cont_three < 3):
    lista_atual = nova_lista[cont_three]
    listAbs = map(abs, lista_atual)                    
    listAbs.sort()                                     
    solMax.append(listAbs[-1])                         
    cont_three += 1

#Check security (request <resistance)
maxRes = z                           
maxSol = solMax

num = (len(maxRes))
cont_four = 0

a = []
p = []

while cont_four < num:
    if solMax[cont_four] < maxRes[cont_four]:
        print ('Barras %i estão OK!' %cont_four)
    else:
        print ('Barras %i estão NOT OK!' %cont_four)
    cont_four += 1
# ---------- end python_4 ----------
info_6 = Panel(python_4.out)
legend = Legend(Colour=beamview.LegendColors, Tags=beamview.LegendTags, LegendType=1)
