# Grasshopper definition template.gh (Grasshopper 0.9.76)
# plug-ins: Python Interpreter

# ---- group: bloco C
# lista de forças
#    resultantes
# análise
# estrutural
# números
# de barras
lng = ListLength()
merge = Merge()  # -> flatten(Result)
merge_2 = Merge(Data1=lng)  # -> flatten(Result)
info = Panel(merge_2)
list_max_resistencias = Number()
info_2 = Panel(merge)
python = PythonScript(x=merge, y=merge_2, z=list_max_resistencias)  # -> out, a; inputs x: list, y: list, z: list
# ---------- python: Python ----------
lista_grande = x #contém os itens da lista grande
sub_lista = y    #contém o TAMANHO das sublistas

size_lista_grande = len(lista_grande)
size_sub_lista = len(sub_lista)

nova_lista = []

for i in range (size_sub_lista):
    nova_lista.append([])

n = int(sub_lista[0])
cont = 0
cont_big_list = 0
cont_sub = 0
while (cont < 3):
    size_atual = y[cont_sub]
    cont_sub += 1
    
    for j in range(int(size_atual)):
        value = x[cont_big_list]
        nova_lista[cont].append(value)
        cont_big_list += 1
    cont += 1

a = nova_lista[2]
#print a

solMax = []                                             #lista de solicitação máxima
cont_three = 0

while (cont_three < 3):
    lista_atual = nova_lista[cont_three]
    listAbs = map(abs, lista_atual)                    # absolute values
    listAbs.sort()                                     # ascending order
    solMax.append(listAbs[-1])                         # highest value
    cont_three += 1

#print(solMax)

#Check security (request <resistance)
maxRes = z                           # *** PROFILES U, B e D***
maxSol = solMax

num = (len(maxRes))
cont_four = 0

a = []
p = []

while cont_four < num:
    if solMax[cont_four] < maxRes[cont_four]:
        print ('Barras %i estão OK!' %cont_four)
    else:
        print ('Barras %i estão NOT OK!' %cont_four)
    cont_four += 1
# ---------- end python ----------
info_3 = Panel(python.out)

# ---- group: bloco B / Resistance (KN/mm²)
panel = Panel("0.25")

# ---- group: bloco B
# resistência
#    máxima
diamêtros = Merge()  # -> flatten(Result)
espessuras = Merge()  # -> flatten(Result)
python_2 = PythonScript(diameterCm=diamêtros, thicknessCm=espessuras, materialResistance=panel)  # -> out, maximumResistance; inputs diameterCm: list, thicknessCm: list
# ---------- python_2: Python ----------
listDiameter = (diameterCm)
listThickness = (thicknessCm)

num = (len(listThickness))
cont = 0

maximumResistance = []

while cont < num:
    diameter = listDiameter[cont] * 10
    thickness = listThickness[cont] * 10
    profileArea = (((3.14159 * diameter ** 2)/4) 
                - ((3.14159 * (diameter-(thickness*2)) **2 )/4))
    maxRes = profileArea * materialResistance
    maximumResistance.append(maxRes)
    cont += 1

size_maximumResistance = len(maximumResistance)
cont_2 = 0
for i in range(size_maximumResistance):
    valor = maximumResistance[cont_2]
    print("Res. Máxima perfil %s = %.2f KN." %(i, valor))
    cont_2 += 1
# ---------- end python_2 ----------
panel_2 = Panel(python_2.maximumResistance)
info_4 = Panel(python_2.out)

# ---- group: bloco A / caminho do arquivo .csv
path = FilePath()

# ---- group: bloco A
# seleção de
#     perfils
index = Slider(18, range=0..29)
merge_3 = Merge(Data1=index)
python_3 = PythonScript(f=path, index=merge_3)  # -> out, graft(lista_perfil); inputs index: list of Int32
# ---------- python_3: Python ----------
import rhinoscriptsyntax as rs

lista = []               # U

f = open(f, 'r')         # open file for reading

for line in f:
    lista_line = line.rstrip().split('\t')
    lista.append(lista_line)

tamanho_index = len(index)

lista_perfil = []
cont = 0

while cont < tamanho_index:      
    i = index[cont]
    profile = lista[i]
    p = profile[0].split(',')  
    diameter = p[0] 
    Diameter = float(diameter) / 10
    lista_perfil.append(Diameter)
    thickness = p[1]
    Thickness = float(thickness) / 10
    lista_perfil.append(Thickness)
    cont += 1

"""
cont_2 = 0
size_lista_perfil = len(lista_perfil)
for i in range(size_lista_perfil):
    print ("Perfil %s. Diametro %.2f cm, espessura %.2f cm" %(i, lista_perfil[cont_2], lista_perfil[cont_2]))
    cont_2 += 2
"""
a = lista_perfil
# ---------- end python_3 ----------
bang = ExplodeTree(Data=python_3.lista_perfil)  # -> Branch0, Branch1
